# Grasshopper definition Chapter2.gh (Grasshopper 1.0.7)

# ---- group: Finds all the factor from num, and sees if its a prime number
c_script = CSharpScript(num=Slider(50, range=0..100))  # -> out, Factors, IsPrime; inputs num: Int32
# ---------- c_script: C# ----------
    List <int> factors = new List <int>();
    IsPrime = isPrimeNum(num, factors);
    Factors = factors;
# ---------- c_script: C# additional code ----------
  bool isPrimeNum (int num, List <int> factors)
  {
    factors.Add(1);
    bool primeFlag = true;

    for(int i = 2; i < (num / 2); i++)
    {
      if(num % i == 0)
      {
        primeFlag = false;
        factors.Add(i);
      }
    }
    factors.Add(num);

    return primeFlag;
  }
# ---------- end c_script ----------
panel = Panel(c_script.Factors)
panel_2 = Panel(c_script.IsPrime)

# ---- group: Divides two numbers by each other
c_script_2 = CSharpScript(x=Slider(100, range=0..100), y=Slider(16, range=0..100))  # -> out, A; inputs x: Double, y: Double
# ---------- c_script_2: C# ----------
    double rc = 0.0;
    bool valid = Divide(x, y, ref rc);

    if (valid == true)
    {
      A = "Look at your answer " + rc;
    }
    else
    {
      A = "You idiot ";
    }
# ---------- c_script_2: C# additional code ----------
  public bool Divide (double x, double y, ref double rc)
  {
    if (Math.Abs(y) < 1e-100)
      return false;
    else
      rc = x / y;
    return true;
  }
# ---------- end c_script_2 ----------
panel_3 = Panel(c_script_2.A)

# ---- group: Using function "System"
c_script_3 = CSharpScript(x=Slider(8, range=0..10))  # -> out, A; inputs x: Double
# ---------- c_script_3: C# ----------
    /*double num = x;
    double sqrNum = System.Math.Sqrt(num);
    A = sqrNum;*/

    A = System.Math.Sqrt(x);
# ---------- end c_script_3 ----------
panel_4 = Panel(c_script_3.A)

# ---- group: Checks if x is a prime number, outputs a boolean
c_script_4 = CSharpScript(x=Slider(50, range=0..100))  # -> out, A; inputs x: Int32
# ---------- c_script_4: C# ----------
    A = isPrimeNum(x);
# ---------- c_script_4: C# additional code ----------
  bool isPrimeNum (int x)
  {
    bool primeFlag = true;

    for(int i = 2; i < (x / 2); i++)
    {
      if(x % 1 == 0)
      {
        primeFlag = false;
        break;
      }
    }
    return primeFlag;
  }
# ---------- end c_script_4 ----------
panel_5 = Panel(c_script_4.A)

# ---- group: Using the break statement to exit a loop
c_script_5 = CSharpScript()  # -> out, A
# ---------- c_script_5: C# ----------
    string [] Fritas = {"mango","apple","orange","strawberry"};

    foreach (string fruit in Fritas) {
      if (fruit == "orange"){
        Print("Found an orange!!!!!");
        break;
      }
    }

    int count = 0;

    foreach (string f in Fritas){
      foreach (char letter in f){
        if (letter == 'r'){
          count = count + 1;
        }
      }
    }

    Print("The letter 'r' is in this list " + count + " times");
# ---------- end c_script_5 ----------
panel_6 = Panel(c_script_5.out)

# ---- group: While loop
c_script_6 = CSharpScript()  # -> out, A
# ---------- c_script_6: C# ----------
    int sum = 0;
    int counter = 0;
    int number = 2;

    //Loop
    while (sum < 1000)
    {
      sum = sum + number;
      // Make sure increment the counter and the number
      counter = counter + 1;
      number = number + 2;
    }

    //Remove lat number
    sum -= number;
    counter--;
    Print("Count = " + counter);
    Print("Sum = " + sum);
# ---------- end c_script_6 ----------
panel_7 = Panel(c_script_6.out)

# ---- group: Creating a list of workdays
c_script_7 = CSharpScript()  # -> out, A
# ---------- c_script_7: C# ----------
    List <string> myWorkDays = new List <string> ();

    myWorkDays.Add("Tuesday");
    myWorkDays.Add("Wednesday");
    myWorkDays.Add("Thursday");
    myWorkDays.Add("Friday");
    
    A = myWorkDays;
# ---------- end c_script_7 ----------
panel_8 = Panel(c_script_7.A)

# ---- group: Count the letter "a" in an array
c_script_8 = CSharpScript()  # -> out, A
# ---------- c_script_8: C# ----------
    string [] Fruits = {"bananas","apples","strawberries","oranges"};
    int count = 0;

    foreach (string f in Fruits) {

      foreach (char letter in f){
        if (letter == 'a'){
          count = count + 1;}
      }
    }

    Print("The letter 'a' repeats " + count + " times");
# ---------- end c_script_8 ----------
panel_9 = Panel(c_script_8.out)

# ---- group: Collatz Conjecture
c_script_9 = CSharpScript()  # -> out, A
# ---------- c_script_9: C# ----------
    int x = 46;
    
    Print(x.ToString());
    
    while (x > 1) {
      if (x % 2 == 0){
        x = x / 2;
      }
      else {
        x = x * 3 + 1;
      }
      Print(x.ToString());
    }
# ---------- end c_script_9 ----------
panel_10 = Panel(c_script_9.out)

# ---- group: Using arrays to display the days of the week
c_script_10 = CSharpScript()  # -> out, A
# ---------- c_script_10: C# ----------
    // Declare and initialize the days of the week array
    string [] weekdays1 = {"Sunday", "Monday","Tuesday","Wednesday","Thursday","Friday","Saturday"};
    A = weekdays1;

    // Declare the days of the week in one statement then assign thr values later

    string [] weekdays = new string [7];
    weekdays[0] = "Sunday";
    weekdays[1] = "Monday";
    weekdays[2] = "Tuesday";
    weekdays[3] = "Wednesday";
    weekdays[4] = "Thursday";
    weekdays[5] = "Friday";
    weekdays[6] = "Saturday";

    A = weekdays;
# ---------- end c_script_10 ----------
panel_11 = Panel(c_script_10.A)
