# Grasshopper definition Chapter3.gh (Grasshopper 1.0.7)

# ---- group: Create new Point
number_slider = Slider(51.27, range=0..100)  # disabled
number_slider_2 = Slider(19.63, range=0..100)  # disabled
number_slider_3 = Slider(79.63, range=0..100)  # disabled
c_script = CSharpScript(x=number_slider_2, y=number_slider, z=number_slider_3)  # -> out, Point; inputs x: Double, y: Double, z: Double; disabled
# ---------- c_script: C# ----------
    //create an instance of a point and initialize to x,y, and z
    Point3d pt = new Point3d (x, y, z);
    
    //assign the point "pt" to output
    Point = pt;
# ---------- end c_script ----------
panel = Panel(c_script.Point)  # disabled

# ---- group: Creating vectors and points
c_script_2 = CSharpScript()  # -> out, Point0, Point1, Vector0, Vector1, Dot, subVectors, adVectors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; disabled
# ---------- c_script_2: C# ----------
    Point3d p0 = new Point3d (3, 6, 0);
    Vector3d v0 = new Vector3d (4, 1.5, 0);
    double factor = 0.5;

    Point3d p1 = new Point3d(Point3d.Unset);
    p1 = p0 + v0;

    double distance = p0.DistanceTo(p1);

    Vector3d v1 = new Vector3d (Vector3d.Unset);
    v1 = Point3d.Origin - p0;

    Vector3d addVectors = new Vector3d (Vector3d.Unset);
    addVectors = v0 + v1;

    Vector3d subtractVectors = v0 - v1;

    double dot = v0 * v1;

    Vector3d cross = new Vector3d(Vector3d.Unset);
    cross = Vector3d.CrossProduct(v0, v1);

    Vector3d scalev0 = new Vector3d(Vector3d.Unset);
    scalev0 = v0 * factor;

    double v0Length = v0.Length;

    v0 = new Vector3d(10, 0, 0);
    v1 = new Vector3d(0, 10, 0);

    v0.Unitize();
    v1.Unitize();
    dot = v0 * v1;

    if((dot < -1.0))
      dot = -1.0;
    if((dot > 1.0))
      dot = 1.0;
    double angle = System.Math.Acos(dot);

    Point0 = p0;
    Point1 = p1;
    Vector0 = v0;
    Vector1 = v1;
    Dot = dot;
    subVectors = subtractVectors;
    adVectors = addVectors;
    Cross = cross;
    Scale = scalev0;
    Angle = angle;
# ---------- end c_script_2 ----------
point = Point(c_script_2.Point0)  # disabled
panel_2 = Panel(c_script_2.Dot)  # disabled
vector_display = VectorDisplay(Anchor=point, Vector=c_script_2.Vector0)  # disabled
panel_3 = Panel("p0")  # disabled
text_tag = TextTag(Location=point, Text=panel_3)  # disabled
vector_display_2 = VectorDisplay(Anchor=point, Vector=c_script_2.adVectors)  # disabled
vector_display_3 = VectorDisplay(Anchor=point, Vector=c_script_2.Vector1)  # disabled
vector_display_4 = VectorDisplay(Anchor=point, Vector=c_script_2.Scale)  # disabled
vector_display_5 = VectorDisplay(Anchor=point, Vector=c_script_2.Cross)  # disabled
panel_4 = Panel("p1")  # disabled
text_tag_2 = TextTag(Location=c_script_2.Point1, Text=panel_4)  # disabled
panel_5 = Panel("0,0,0")  # disabled
vector_display_6 = VectorDisplay(Anchor=panel_5, Vector=c_script_2.subVectors)  # disabled

# ---- group: Dissecting the Point, taking out x, y, and z
point_2 = Point(Point(19.63, 51.27, 79.63))  # disabled
c_script_3 = CSharpScript(pt=point_2)  # -> out, A, B, C; inputs pt: Point3d; disabled
# ---------- c_script_3: C# ----------
    A = pt.X;
    B = pt.Y;
    C = pt.Z;
# ---------- end c_script_3 ----------
panel_6 = Panel(c_script_3.C)  # disabled
panel_7 = Panel(c_script_3.B)  # disabled
panel_8 = Panel(c_script_3.A)  # disabled

# ---- group: Creating a point and finding the distance of it to another point
point_3 = Point(Point(0, 5, 0))  # disabled
number_slider_4 = Slider(3, range=1..10)  # disabled
number_slider_5 = Slider(2, range=1..10)  # disabled
number_slider_6 = Slider(1, range=1..10)  # disabled
panel_9 = Panel(point_3)  # disabled
c_script_4 = CSharpScript(x=number_slider_6, y=number_slider_5, z=number_slider_4, other=panel_9)  # -> out, Point, Distance; inputs x: Double, y: Double, z: Double, other: Point3d; disabled
# ---------- c_script_4: C# ----------
    Point3d pt = new Point3d(x, y, z);
    double dist = pt.DistanceTo(other);
    Point = pt;
    Distance = dist;
# ---------- end c_script_4 ----------
panel_10 = Panel(c_script_4.Point)  # disabled
panel_11 = Panel(c_script_4.Distance)  # disabled

# ---- group: Get the origin points
c_script_5 = CSharpScript()  # -> out, Origin; disabled
# ---------- c_script_5: C# ----------
    Origin = Point3d.Origin;
# ---------- end c_script_5 ----------
panel_12 = Panel(c_script_5.Origin)  # disabled

# ---- group: Creating new Point, first making it null then adding the points in there
number_slider_7 = Slider(3.1, range=0..10)  # disabled
number_slider_8 = Slider(2.1, range=0..10)  # disabled
number_slider_9 = Slider(4.1, range=0..10)  # disabled
c_script_6 = CSharpScript(x=number_slider_8, y=number_slider_7, z=number_slider_9)  # -> out, Point; inputs x: Double, y: Double, z: Double; disabled
# ---------- c_script_6: C# ----------
    //declare a new point
    Point3d newPoint = new Point3d (Point3d.Unset);

    //set "newPoint" coordinates
    newPoint.X = x;
    newPoint.Y = y;
    newPoint.Z = z;

    //assign the point coordinates to output
    Point = newPoint;
# ---------- end c_script_6 ----------
panel_13 = Panel(c_script_6.Point)  # disabled

# ---- group: Substituting the point as the origin
c_script_7 = CSharpScript()  # -> out, Arc, Circle, Lines; disabled
# ---------- c_script_7: C# ----------
    Random rnd = new Random ();
    double radius = rnd.Next(10, 20);

    Point3d point = new Point3d (2, 1, 0);

    Plane plane = Plane.WorldXY;
    plane.Origin = point;

    Circle circle = new Circle (plane, radius);
    Circle = circle;

    //This is like bounds in Rhino components (Interval)
    Interval angle = new Interval(0, Math.PI);

    Arc arc = new Arc (circle, angle);

    Arc = arc;

    Point3d pt1arc = arc.EndPoint;
    Point3d pt2arc = arc.StartPoint;

    Point3d pt1moved = new Point3d (pt1arc);
    pt1moved.Transform(Transform.Translation(0, 0, 10));


    Point3d pt2moved = new Point3d (pt2arc);
    pt2arc.Transform(Transform.Translation(0, 0, 10));

    Line line1 = new Line (pt1arc, pt1moved);
    Line line2 = new Line (pt2arc, pt2moved);

    List <Line> lines = new List <Line> () {line1, line2};

    Lines = lines;
# ---------- end c_script_7 ----------
curve = Curve(c_script_7.Circle)  # disabled
curve_2 = Curve(c_script_7.Arc)  # disabled
curve_3 = Curve(c_script_7.Lines)  # disabled
merge = Merge(Data1=curve_2, Data2=curve, Data3=curve_3)  # disabled

# ---- group: Creating geometries in Rhino
c_script_8 = CSharpScript()  # -> out, Line, Polyline, Arc, Circle, Ellipse; disabled
# ---------- c_script_8: C# ----------
    Point3d p0 = new Point3d (0, 0, 0);
    Point3d p1 = new Point3d (5, 1, 0);
    Point3d p2 = new Point3d (6, -3, 0);

    Rhino.Geometry.Line line = new Line (p0, p1);
    Line = line;

    List < Point3d > pts = new List <Point3d> (){p0,p1,p2};
    /*pts.Add(p0);
    pts.Add(p1);
    pts.Add(p2);*/

    Rhino.Geometry.Polyline polyline = new Polyline(pts);
    Polyline = polyline;

    Rhino.Geometry.Circle circle = new Circle(p1, 2);
    Circle = circle;

    Rhino.Geometry.Arc arc = new Arc(circle, 0.234);
    Arc = arc;

    Rhino.Geometry.Ellipse ellipse = new Ellipse(p0, p1, p2);
    Ellipse = ellipse;
# ---------- end c_script_8 ----------
line = Line(c_script_8.Line)  # disabled
curve_4 = Curve(c_script_8.Polyline)  # disabled
curve_5 = Curve(c_script_8.Circle)  # disabled
curve_6 = Curve(c_script_8.Ellipse)  # disabled
curve_7 = Curve(c_script_8.Arc)  # disabled

# ---- group: Create a list of turning ellipses
c_script_9 = CSharpScript()  # -> out, Ellipse; disabled
# ---------- c_script_9: C# ----------
    double angle = 0.01;
    int ellipseCount = 20;
    double x = 1.5;

    List<Ellipse> ellipseList = new List <Ellipse> ();

    Plane plane = Plane.WorldXY;

    for(int i = 1; i <= ellipseCount; i++)
    {
      Point3d pt = new Point3d (x, 0, 0);
      Vector3d y = new Vector3d (0, 1, 0);
      plane.Rotate(angle * i, y, pt);

      Ellipse ellipse = new Ellipse (plane, (double) i / 2, i);

      ellipseList.Add(ellipse);
    }

    Ellipse = ellipseList;
# ---------- end c_script_9 ----------
geometry = Geometry(c_script_9.Ellipse)  # disabled

# ---- group: Creating 3D Objects
c_script_10 = CSharpScript()  # -> out, Sphere, Cylinder, Cone, Torus; disabled
# ---------- c_script_10: C# ----------
    Rhino.Geometry.Sphere sphere = new Sphere(new Point3d (2, 4, 0), 3);
    Sphere = sphere;

    Rhino.Geometry.Circle circle = new Circle(2);
    Rhino.Geometry.Cylinder cylinder = new Cylinder(circle, 3);
    Cylinder = cylinder;

    Rhino.Geometry.Cone cone = new Cone (Plane.WorldXY, 4, 2);
    Cone = cone;

    Rhino.Geometry.Torus torus = new Torus (Plane.WorldXY, 3, 1);
    Torus = torus;
# ---------- end c_script_10 ----------
geometry_2 = Geometry(c_script_10.Sphere)  # disabled
geometry_3 = Geometry(c_script_10.Cylinder)  # disabled
geometry_4 = Geometry(c_script_10.Cone)  # disabled
geometry_5 = Geometry(c_script_10.Torus)  # disabled

# ---- group: Create a Geometry Composition
point_4 = Point(Point(-14, 0, 3))  # disabled
point_5 = Point(Point(0, 8, 0))  # disabled
point_6 = Point(Point(-14, 0, 0))  # disabled
point_7 = Point(Point(14, 0, 0))  # disabled
c_script_11 = CSharpScript(pt1=point_7, pt2=point_5, pt3=point_6, pt4=point_4)  # -> out, Arc, Cylinder, Sphere, Lines; inputs pt1: Point3d, pt2: Point3d, pt3: Point3d, pt4: Point3d; disabled
# ---------- c_script_11: C# ----------
    Point3d pt1moved = new Point3d(pt1);
    pt1moved.Transform(Transform.Translation(0, 0, 8));

    Point3d pt3moved = new Point3d(pt3);
    pt3moved.Transform(Transform.Translation(0, 0, 6));

    Rhino.Geometry.Arc arc = new Arc (pt1, pt2, pt3);
    Arc = arc;

    Rhino.Geometry.Circle circle = new Circle (pt1, 2);
    Rhino.Geometry.Cylinder cylinder = new Cylinder (circle, 8);
    Cylinder = cylinder;

    Rhino.Geometry.Sphere sphere = new Sphere(pt4, 1);
    Sphere = sphere;

    Rhino.Geometry.Line line1 = new Line (pt1, pt1moved);
    Rhino.Geometry.Line line2 = new Line (pt3, pt3moved);

    List <Line> lines = new List <Line> () {line1, line2};
    Lines = lines;
# ---------- end c_script_11 ----------
geometry_6 = Geometry(c_script_11.Arc)  # disabled
geometry_7 = Geometry(c_script_11.Sphere)  # disabled
geometry_8 = Geometry(c_script_11.Cylinder)  # disabled
geometry_9 = Geometry(c_script_11.Lines)  # disabled
merge_2 = Merge(Data1=geometry_6, Data2=geometry_8, Data3=geometry_7, Data4=geometry_9)  # disabled

# ---- group: Moving point by Transform (Vector3d)
panel_14 = Panel("4,5,6")  # disabled
move = Move(Motion=panel_14)  # -> Geometry, Transform; disabled
point_8 = Point(Point(0, 5, 0))  # disabled
c_script_12 = CSharpScript(Point=point_8, xform=move.Transform)  # -> out, newPt; inputs Point: Point3d, xform: Transform; disabled
# ---------- c_script_12: C# ----------
    Point3d pt = new Point3d(Point);
    pt.Transform(xform);
    newPt = pt;
# ---------- end c_script_12 ----------
panel_15 = Panel(c_script_12.newPt)  # disabled

# ---- group: Using vector method
c_script_13 = CSharpScript()  # -> out, Arc, Circle, Lines; disabled
# ---------- c_script_13: C# ----------
    Random rnd = new Random ();
    double radius = rnd.Next(10, 20);

    Point3d point = new Point3d (2, 1, 0);

    Plane plane = Plane.WorldXY;
    plane.Origin = point;

    Circle circle = new Circle (plane, radius);
    Circle = circle;

    //This is like bounds in Rhino components (Interval)
    Interval angle = new Interval(0, Math.PI);

    Arc arc = new Arc (circle, angle);

    Arc = arc;

    Point3d endPoint = arc.EndPoint;
    Point3d startPoint = arc.StartPoint;

    Vector3d vec = Vector3d.ZAxis;
    vec = vec * 10;
    
    Line line1 = new Line (startPoint, vec);
    Line line2 = new Line (endPoint, vec);

    List <Line> lines = new List <Line> () {line1, line2};

    Lines = lines;
# ---------- end c_script_13 ----------
curve_8 = Curve(c_script_13.Circle)  # disabled
curve_9 = Curve(c_script_13.Arc)  # disabled
curve_10 = Curve(c_script_13.Lines)  # disabled
merge_3 = Merge(Data1=curve_9, Data2=curve_8, Data3=curve_10)  # disabled

# ---- group: Creating a random radius
c_script_14 = CSharpScript()  # -> out, Circle; disabled
# ---------- c_script_14: C# ----------
    Point3d pt1 = new Point3d (2, 1, 0);
    Random rand = new Random ();
    double radius = rand.Next(10, 20);

    Circle circle = new Circle(Plane.WorldXY, pt1, radius);

    Circle = circle;
# ---------- end c_script_14 ----------
curve_11 = Curve(c_script_14.Circle)  # disabled

# ----
point_9 = Point([Point(0, 6, 0), Point(5, 5, 0), Point(1, -2, 0), Point(16, 9, 0)])
c_script_15 = CSharpScript(pts=point_9)  # -> out, Crv, Type; inputs pts: list of Point3d
# ---------- c_script_15: C# ----------
    var crv = new Rhino.Geometry.Polyline(pts);

    Crv = crv;
    Type = crv.GetType();
# ---------- end c_script_15 ----------
panel_16 = Panel(c_script_15.Type)
curve_12 = Curve(c_script_15.Crv)

# ---- group: Changing the value for x in a function
panel_17 = Panel("19")  # disabled
panel_18 = Panel("0")  # disabled
c_script_16 = CSharpScript(x=panel_17, y=panel_18, z=panel_18)  # -> out, Point; inputs x: Double, y: Double, z: Double; disabled
# ---------- c_script_16: C# ----------
    Point3d pt = new Point3d (x, y, z);
    Print("Before the Change.X = " + pt.X);

    ChangeX(pt);

    Print("After the Change.X = " + pt.X);
    Point = pt;
# ---------- c_script_16: C# additional code ----------
  public void ChangeX (Point3d pt){
    pt.X = 100;
    Print("Inside the Change.X =" + pt);
  }
# ---------- end c_script_16 ----------
panel_19 = Panel(c_script_16.out)  # disabled
panel_20 = Panel(c_script_16.Point)  # disabled

# ---- group: Checks if the list of points are co-planar
panel_21 = Panel("""4,5,6
1,1,6
0,0,6""")  # disabled
panel_22 = Panel("0.01")  # disabled
c_script_17 = CSharpScript(pts=panel_21, tolerance=panel_22)  # -> out, IsCoPlanar; inputs pts: list of Point3d, tolerance: Double; disabled
# ---------- c_script_17: C# ----------
    //Test if the list of input points are coplanar
    bool coplaner = Point3d.ArePointsCoplanar(pts, tolerance);
    
    //assign the co-planar test to output
    IsCoPlanar = coplaner;
# ---------- end c_script_17 ----------
panel_23 = Panel(c_script_17.IsCoPlanar)  # disabled

# ---- group: Sums two points together
panel_24 = Panel("1,2,3")  # disabled
panel_25 = Panel("3,2,1")  # disabled
c_script_18 = CSharpScript(pt1=panel_25, pt2=panel_24)  # -> out, sumpt; inputs pt1: Point3d, pt2: Point3d; disabled
# ---------- c_script_18: C# ----------
    sumpt = pt1 + pt2;
# ---------- end c_script_18 ----------
panel_26 = Panel(c_script_18.sumpt)  # disabled

# ----
panel_27 = Panel(c_script_2.Angle)  # disabled
degrees = Degrees(Radians=panel_27)  # disabled
panel_28 = Panel(degrees)  # disabled
