# Grasshopper definition Chapter4.gh (Grasshopper 1.0.7)

# ---- group: Create curves and surfaces using the sine equation
c_script = CSharpScript(num=Slider(45, range=1..100))  # -> out, OutCurves, OutSurface, OutLoft; inputs num: Int32
# ---------- c_script: C# ----------
    //List of all points
    List<Point3d> allPoints = new List<Point3d>();
    //List of curves
    List<Curve> curves = new List<Curve>();

    for(int y = 0; y < num; y++)
    {
      //Curve points
      List<Point3d> crvPoints = new List<Point3d>();
      for(int x = 0; x < num; x++)
      {
        double z = Math.Sin(Math.PI / 180 + (x + y));
        Point3d pt = new Point3d(x, y, z);
        crvPoints.Add(pt);
        allPoints.Add(pt);
      }

      //Create a degree 3 nurbs curve from control points
      Curve crv = Curve.CreateControlPointCurve(crvPoints, 3);
      curves.Add(crv);
    }

    //Create a nurbs surface from control points
    NurbsSurface srf = NurbsSurface.CreateFromPoints(allPoints, num, num, 3, 3);
    //Create a loft brep from curves
    Brep[] breps = Brep.CreateFromLoft(curves, Point3d.Unset, Point3d.Unset, LoftType.Tight, false);

    //Assign the outputs
    OutCurves = curves;
    OutSurface = srf;
    OutLoft = breps;
# ---------- end c_script ----------
geometry = Geometry(c_script.OutCurves)
geometry_2 = Geometry(c_script.OutLoft)
geometry_3 = Geometry(c_script.OutSurface)

# ----
point = Point(Point(-40, 13, 0))
point_2 = Point(Point(-17, 0, 0))
point_3 = Point(Point(-40, 0, 0))
point_4 = Point(Point(-25, 11, 0))
c_script_2 = CSharpScript(pt0=point_3, pt1=point, pt2=point_4, pt3=point_2, segments=Slider(16, range=2..16))  # -> out, BezierCrv; inputs pt0: Point3d, pt1: Point3d, pt2: Point3d, pt3: Point3d, segments: Int32
# ---------- c_script_2: C# ----------
    if (segments < 2)
      segments = 2;

    List <Point3d> bezierPts = new List<Point3d>();
    bezierPts.Add(pt0);
    bezierPts.Add(pt1);
    bezierPts.Add(pt2);
    bezierPts.Add(pt3);

    List<Point3d> evalPts = new List<Point3d>();
    double step = 1 / (double) segments;
    for(int i = 0;i <= segments;i++)
    {
      double t = i * step;
      Point3d pt = Point3d.Unset;
      EvalPoint(bezierPts, t, ref pt);

      if(pt.IsValid)
        evalPts.Add(pt);
    }

    Polyline pline = new Polyline(evalPts);
    BezierCrv = pline;
# ---------- c_script_2: C# additional code ----------
  void EvalPoint(List<Point3d> points, double t, ref Point3d evalPt)
  {
    //Stopping condition - point at parameter "t" is found
    if(points.Count < 2)
      return;
    List <Point3d> tPoints = new List<Point3d>();
    for(int i = 1; i < points.Count; i++)
    {
      Line line = new Line(points[i - 1], points[i]);
      Point3d pt = line.PointAt(t);
      tPoints.Add(pt);
    }

    if(tPoints.Count == 1)
      evalPt = tPoints[0];
    EvalPoint(tPoints, t, ref evalPt);
  }
# ---------- end c_script_2 ----------
geometry_4 = Geometry(c_script_2.BezierCrv)
