# Grasshopper definition Grid.gh (Grasshopper 1.0.7)
# plug-ins: Bifocals

number_slider = Slider(26, range=0..100)
square = Square(Plane=PlaneXY(0, 0, 0), Size=Slider(0.9, range=0..1), ExtentX=number_slider, ExtentY=number_slider)  # -> Cells, Points

# ---- group: Individual Geometry Cell
# we want the user to pick how big the square/rectangle cells and choose choose the measurments for x and y. Then how big the whole figure should be. the program divides the hugness of the square by the individual measurements of a cells. To create you "perfect" grid.
rectangle = Rectangle(Plane=PlaneXY(0, 0, 0), XSize=Slider(0, range=0..5), YSize=Slider(0, range=0..5), Radius=0)  # -> Rectangle, Length

# ---- group: Whole Geometry in which we want to pack the cells in
# **Extension**
# 1.Rectangle/Square
# 2.Polylines or wierd squiggles
rectangle_2 = Rectangle(Plane=PlaneXY(0, 0, 0), XSize=Slider(50, range=0..100), YSize=Slider(50, range=0..100), Radius=0)  # -> Rectangle, Length
