# Grasshopper definition Triangle_from_Scratch_project.gh (Grasshopper 1.0.7)

negative = Negative(Value=Slider(5, range=0..10))
negative_2 = Negative(Value=Slider(10, range=0..10))
negative_3 = Negative(Value=Slider(5, range=0..10))
construct_point = ConstructPoint(XCoordinate=negative_2, YCoordinate=0, ZCoordinate=0)
construct_point_2 = ConstructPoint(XCoordinate=0, YCoordinate=0, ZCoordinate=0)
construct_point_3 = ConstructPoint(XCoordinate=negative, YCoordinate=negative_3, ZCoordinate=0)
construct_point_4 = ConstructPoint(XCoordinate=Slider(10, range=0..10), YCoordinate=0, ZCoordinate=0)
construct_point_5 = ConstructPoint(XCoordinate=0, YCoordinate=0, ZCoordinate=0)
construct_point_6 = ConstructPoint(XCoordinate=Slider(5, range=0..10), YCoordinate=Slider(5, range=0..10), ZCoordinate=0)
line = Line(StartPoint=construct_point, EndPoint=construct_point_2)
line_2 = Line(StartPoint=construct_point_2, EndPoint=construct_point_3)
line_3 = Line(StartPoint=construct_point, EndPoint=construct_point_3)
line_4 = Line(StartPoint=construct_point_4, EndPoint=construct_point_5)
line_5 = Line(StartPoint=construct_point_5, EndPoint=construct_point_6)
line_6 = Line(StartPoint=construct_point_4, EndPoint=construct_point_6)
merge = Merge(Data2=line, Data3=line_2, Data4=line_3)
merge_2 = Merge(Data2=line_4, Data3=line_5, Data4=line_6)
xy_plane = XYPlane(Origin=Point(0, 0, 0))
move = Move(Geometry=merge, Motion=xy_plane)  # -> Geometry, Transform
